% Simulink data dictionary eomParameters.sldd

C_d = Simulink.Parameter(0.55)
A_ball = Simulink.Parameter(Simulink.data.Expression(ExpressionString=" pi *r_ball^2"))
A = Simulink.Parameter(Simulink.data.Expression(ExpressionString="7/5 * m_ball"), StorageClass="ExportedGlobal")
B = Simulink.Parameter(Simulink.data.Expression(ExpressionString="g*m_rack*r_p"), StorageClass="ExportedGlobal")
C = Simulink.Parameter(Simulink.data.Expression(ExpressionString=" -g*m_ball"), StorageClass="ExportedGlobal")
d = Simulink.Parameter(Simulink.data.Expression(ExpressionString=" 1/2 * p_air * C_d * A_ball"), StorageClass="ExportedGlobal")
D = Simulink.Parameter(Simulink.data.Expression(ExpressionString=" (L-OS)^2/r_p^2"), StorageClass="ExportedGlobal")
F = Simulink.Parameter(Simulink.data.Expression(ExpressionString=" -g*m_ball*r_ball*r_p/(L-OS)"), StorageClass="ExportedGlobal")
H = Simulink.Parameter(Simulink.data.Expression(ExpressionString=" m_platform *((L/2-OS)^2 + L^2/12)/r_p^2"), StorageClass="ExportedGlobal")
I = Simulink.Parameter(Simulink.data.Expression(ExpressionString=" g*m_ball*r_ball / (L-OS)"), StorageClass="ExportedGlobal")
K = Simulink.Parameter(Simulink.data.Expression(ExpressionString=" g*m_ball*(L-OS)"), StorageClass="ExportedGlobal")
mu = Simulink.Parameter(0.4, StorageClass="ExportedGlobal")
mu_r = Simulink.Parameter(0.001, StorageClass="ExportedGlobal")
E = Simulink.Parameter(Simulink.data.Expression(ExpressionString=" g*m_ball*L + L *g*m_platform/2"), StorageClass="ExportedGlobal")
L_1 = Simulink.Parameter(Simulink.data.Expression(ExpressionString="m_ball*g*(L-OS)/r_p"), StorageClass="ExportedGlobal")

paramsBus = Simulink.Bus()
  A: double
  B: double
  C: double
  D: double
  E: double
  F: double
  H: double
  I: double
  K: double
  b: double
  d: double
  mu: double
  mu_r: double
  L_1: double

g = Simulink.Parameter(9.81)
m_ball = Simulink.Parameter(0.024)
L = Simulink.Parameter(0.1)
r_ball = Simulink.Parameter(0.009)
m_platform = Simulink.Parameter(0.227)
m_rack = Simulink.Parameter(0.05)
OS = Simulink.Parameter(0.04)
r_p = Simulink.Parameter(0.064)
p_air = Simulink.Parameter(1.19)
b = Simulink.Parameter(0.1, StorageClass="ExportedGlobal")
J = Simulink.Parameter(Simulink.data.Expression(ExpressionString="2*r_p^2*(m_pinion/4 + m_rack/2)"))
m_pinion = Simulink.Parameter(0.191)